# Grasshopper definition [quick-start]bilayer-stick.gh (Grasshopper 1.0.8)
# plug-ins: Morpho4D Info

# ----
# Construct PLA Material
material_base = MaterialBase(Name="myPLA", PreviewColor=ColourSwatch(SwatchColor=RGB(255, 255, 255)), YoungsModulus="10", PoissonsRatio="0.35")
construct_pla = ConstructPLA(MaterialBase=material_base, ThermalSoftening="0")  # -> PLAMaterial, Inspection

define_sigmoid = DefineSigmoid(GlassTransitionTemperature="60", GlassyModulus="2000", RubberyModulus="1", Steepness="0.3")
# Construct SMP Material
material_base_2 = MaterialBase(Name="mySMP", PreviewColor=ColourSwatch(SwatchColor=RGB(224, 112, 112)), YoungsModulus="2000", PoissonsRatio="0.4")
construct_smp = ConstructSMP(
    MaterialBase=material_base_2,
    MaxSwellingRatio=Slider(1.5, range=0..10),
    MinSwellingRatio=Slider(1, range=0..10),
    SigmoidModel=define_sigmoid)  # -> SMP, Inspection

xy_plane = XYPlane(Origin=Point(0, 0, 0))
# Create a Box
panel = Panel("0,0,0")
box_2pt = Box2Pt(PointA=panel, PointB="20,200,2", Plane=xy_plane)

# ----
# Voxelization
brep_to_voxel = BrepToVoxel(Brep=box_2pt, Size="2", Material=construct_pla.PLAMaterial)  # -> Voxels, Inspection
panel_2 = Panel(brep_to_voxel.Inspection)
show_voxels = ShowVoxels(Voxels=brep_to_voxel.Voxels, Size="2")  # -> Mesh, Points

# ----
# Set Bilayer Material and Fiber Direction
xy_plane_2 = XYPlane(Origin="0,0,1")
bilayer_material = BilayerMaterial(
    Voxels=brep_to_voxel.Voxels,
    ActiveMaterial=construct_smp.SMP,
    PassiveMaterial=construct_pla.PLAMaterial,
    SplitPlane=xy_plane_2)  # -> Voxels, ActiveCount, PassiveCount
panel_3 = Panel(bilayer_material.ActiveCount)
panel_4 = Panel(bilayer_material.PassiveCount)
unit_y = UnitY(Factor=1)
set_fiber_direction = SetFiberDirection(Voxels=bilayer_material.Voxels, FiberDirection=unit_y, EpsMax="-1.0")  # -> Voxels, UpdatedCount
panel_5 = Panel(set_fiber_direction.UpdatedCount)

deconstruct = Deconstruct(Point=show_voxels.Points)  # -> XComponent, YComponent, ZComponent
# Set Anchor Points
equality = Equality(FirstNumber=deconstruct.YComponent, SecondNumber="0")  # -> Equality, Inequality
equality_2 = Equality(FirstNumber=deconstruct.ZComponent, SecondNumber="0")  # -> Equality, Inequality
gate_and = GateAnd(A=equality.Equality, B=equality_2.Equality)
cull_pattern = CullPattern(List=show_voxels.Points, CullPattern=gate_and)
anchor = Anchor(Voxels=set_fiber_direction.Voxels, Points=cull_pattern)

# ----
# Set Stimulus and Activate Solver
number_slider = Slider(0, range=0..100)
set_heat_stimuulus = SetHeatStimuulus(StimulusName="myStim", Temperature="100")  # -> Stimulus, Inspection
morpho_solver = MorphoSolver(Voxels=anchor, Stimulus=set_heat_stimuulus.Stimulus)  # -> Mesh, Points, Voxels, Diag
number_slider_2 = Slider(0, range=0..100)
panel_6 = Panel(morpho_solver.Diag)
mesh = Mesh(morpho_solver.Mesh)
recovery_solver = RecoverySolver(Voxels=morpho_solver.Voxels)  # -> Mesh, Points, Voxels, Diag
